vi "index.gviweb"   [G Web Development Software 22.0.0]
panel controls:
  "selector": bool
panel indicators:
  "body": string
  "error out": error
  "current time": timestamp
  "window location": string
  "relative url": T1
  "current url": T1
  "URL Request": string
types:
  T1 = cluster{"href": string, "origin": string, "protocol": string, "username": string, "password": string, "host": string, "hostname": string, "port": string, "pathname": string, "search": string, "hash": string}
uses:
  UtilityJSLI::API::URL::GetURL.gvi
  UtilityJSLI::API::URL::ParseURL.gvi
  NI::HTTP::POST Buffer.gvi
diagram:
  # Place setup code before the loop. For example, perform initial data communication and wire the results into the loop.
  # Top-Level WebVIs usually contain a While Loop that never stops so that they can continue running as long as the web page is open in the user's web browser.
  while {
    case ($selector) {
      frame False, Default { }
      frame True {
        call "GetURL.gvi"() -> (url=w1)
        call "ParseURL.gvi"(url="CSM-RunScript", base=w1) -> (url parts=w2)
        Property Node(instance in=w2) -> ("href"=w3)
        $"URL Request" <- w3
        call "POST Buffer.gvi"(url=w3, buffer="API: API1 -@ CSM") -> (body=w4, error out=w5)
        $body <- w4
        Get Current Time() -> (current time=w6)
        $"current time" <- w6
        $"error out" <- w5
      }
    }
    Wait(time to wait=50)
    stop if FALSE
  }
  call "GetURL.gvi"() -> (url=w7)
  $"window location" <- w7
  call "ParseURL.gvi"(url=w7) -> (url parts=w8)
  $"current url" <- w8
  w9 = "../index.html"  # relative url
  call "ParseURL.gvi"(url=w9, base=w7) -> (url parts=w10)
  $"relative url" <- w10
